% Simulink data dictionary battery.sldd

ALPHA = -5.738
BETA = 209.9
HEAT_CAPACITY = 105.3
LOWER_VOLT_CF = 2.75
R_IN = 1.8
R_OUT = 15.8
T_AMB = 298
T_REF = 273
UPPER_VOLT_CF = 4.2
OCV_ALPHA = 0.15
OCV_BETA = 17
OCV_GAMMA = 10.5
OCV_V0 = 4.14
OCV_VL = 3.977
INTERNAL_RESISTANCE = 0.12
NOMINAL_CAPACITY = 14400
EHC_A = 4.0e-5
EHC_KAPPA = 3
EHC_MU = 0.4
EHC_SIGMA = 0.05
EHC_LAMBDA = 7
EHC_B = 5.0e-5
Sig = Simulink.Signal()